vi "index.gviweb"   [G Web Development Software 22.3.0]
panel indicators:
  "Current Temperature": f64
  "Gauge": f64
  "Chart": f64[]
  "Overheat": bool
diagram:
  # Place setup code before the loop. For example, perform initial data communication and wire the results into the loop.
  # Top-Level WebVIs usually contain a While Loop that never stops so that they can continue running as long as the web page is open in the user's web browser.
  s1 = uninitialised  # shift register
  while {
    Random Number() -> (number (0 to 1)=w1)
    Multiply(w1, 80) -> w2
    Add(w2, 20) -> w3
    Is Greater(x=w3, y=80) -> w4
    $Overheat <- w4
    $"Current Temperature" <- w3
    $Gauge <- w3
    Build Array(w3, s1) -> w5
    $Chart <- w5
    Wait(time to wait=1000)
    next s1 = w5
    stop if FALSE
  }
